% Simulink data dictionary fbw_data.sldd

base_roll = Simulink.Bus()
  data_computed: Bus: base_roll_data_computed
  law_normal: Bus: base_roll_normal
  output: Bus: base_roll_output

fbw_output = Simulink.Bus()
  sim: Bus: base_sim
  pitch: Bus: base_pitch
  roll: Bus: base_roll

base_input = Simulink.Bus()
  delta_eta_pos: double, Min=-1, Max=1, Unit="1"
  delta_xi_pos: double, Min=-1, Max=1, Unit="1"
  delta_zeta_pos: double, Min=-1, Max=1, Unit="1"

base_raw_output = Simulink.Bus()
  eta_pos: double, Min=-1, Max=1, Unit="deg"
  eta_trim_deg: double, Unit="deg"
  eta_trim_deg_should_write: boolean, Min=0, Max=1
  xi_pos: double, Min=-1, Max=1, Unit="1"
  zeta_pos: double, Min=-1, Max=1, Unit="1"
  zeta_trim_pos: double, Min=-1, Max=1, Unit="1"

base_output = Simulink.Bus()
  eta_deg: double, Min=-30, Max=17, Unit="deg"
  eta_trim_deg: double, Min=-13.5, Max=4, Unit="deg"
  eta_trim_deg_should_write: boolean, Min=0, Max=1
  xi_deg: double, Min=-25, Max=25, Unit="deg"
  zeta_deg: double, Min=-25, Max=25, Unit="deg"
  zeta_trim_deg: double, Min=-20, Max=20, Unit="deg"

base_pitch_output = Simulink.Bus()
  eta_deg: double, Min=-30, Max=17, Unit="deg"
  eta_trim_deg: double, Min=-13.5, Max=4, Unit="deg"

base_roll_normal = Simulink.Bus()
  pk_c_deg_s: double, Unit="deg/s"
  Phi_c_deg: double, Unit="deg"
  xi_deg: double, Min=-25, Max=25, Unit="deg"
  zeta_deg: double, Min=-25, Max=25, Unit="deg"

base_roll_output = Simulink.Bus()
  xi_deg: double, Min=-25, Max=25, Unit="deg"
  zeta_deg: double, Min=-25, Max=25, Unit="deg"

base_pitch_data_computed = Simulink.Bus()
  delta_eta_deg: double, Min=-30, Max=17, Unit="deg"
  in_flight: double, Min=0, Max=1, Unit="1"
  in_flare: double, Min=0, Max=1, Unit="1"
  in_flight_gain: double, Min=0, Max=1, Unit="1"
  nz_limit_up_g: double, Unit="gn"
  nz_limit_lo_g: double, Unit="gn"
  eta_trim_deg_should_freeze: boolean
  eta_trim_deg_reset: boolean
  eta_trim_deg_reset_deg: double, Unit="deg"
  eta_trim_deg_should_write: boolean
  eta_trim_deg_rate_limit_up_deg_s: double, Unit="deg/s"
  eta_trim_deg_rate_limit_lo_deg_s: double, Unit="deg/s"
  flare_Theta_deg: double, Unit="deg"
  flare_Theta_c_deg: double, Unit="deg"
  flare_Theta_c_rate_deg_s: double, Unit="deg/s"

base_roll_data_computed = Simulink.Bus()
  delta_xi_deg: double, Min=-25, Max=25, Unit="deg"
  delta_zeta_deg: double, Min=-25, Max=25, Unit="deg"
  in_flight: double, Min=0, Max=1, Unit="1"
  in_flight_gain: double, Min=0, Max=1, Unit="1"

base_pitch_law_output = Simulink.Bus()
  eta_dot_deg_s: double, Unit="deg/s"

base_pitch_integrated = Simulink.Bus()
  eta_deg: double, Min=-30, Max=17, Unit="deg"

base_pitch_normal = Simulink.Bus()
  nz_c_g: double, Unit="gn"
  Cstar_g: double, Unit="gn"
  eta_dot_deg_s: double, Unit="deg/s"

base_pitch = Simulink.Bus()
  data_computed: Bus: base_pitch_data_computed
  law_normal: Bus: base_pitch_normal
  vote: Bus: base_pitch_law_output
  integrated: Bus: base_pitch_integrated
  output: Bus: base_pitch_output

fbw_input = Simulink.Bus()
  time: Bus: base_raw_time
  data: Bus: base_raw_data
  input: Bus: base_input

base_raw_time = Simulink.Bus()
  dt: double, Unit="s"

base_raw = Simulink.Bus()
  time: Bus: base_raw_time
  data: Bus: base_raw_data
  input: Bus: base_input
  output: Bus: base_raw_output

base_sim = Simulink.Bus()
  raw: Bus: base_raw
  time: Bus: base_time
  data: Bus: base_data
  data_computed: Bus: base_data_computed
  input: Bus: base_input

base_time = Simulink.Bus()
  dt: double, Unit="s"
  monotonic_time: double, Min=0, Unit="s"

base_raw_data = Simulink.Bus()
  nz_g: double, Unit="gn"
  Theta_deg: double, Unit="deg"
  Phi_deg: double, Unit="deg"
  q_rad_s: double, Unit="rad/s"
  r_rad_s: double, Unit="rad/s"
  p_rad_s: double, Unit="rad/s"
  q_dot_rad_s2: double, Unit="rad/s^2"
  r_dot_rad_s2: double, Unit="rad/s^2"
  p_dot_rad_s2: double, Unit="rad/s^2"
  eta_pos: double, Min=-1, Max=1, Unit="1"
  eta_trim_deg: double, Unit="deg"
  xi_pos: double, Min=-1, Max=1, Unit="1"
  zeta_pos: double, Min=-1, Max=1, Unit="1"
  zeta_trim_pos: double, Min=-1, Max=1, Unit="1"
  alpha_deg: double, Unit="deg"
  beta_deg: double, Unit="deg"
  beta_dot_deg_s: double, Unit="deg/s"
  V_ias_kn: double, Unit="kn"
  V_tas_kn: double, Unit="kn"
  V_mach: double, Unit="1"
  H_ft: double, Unit="ft"
  H_ind_ft: double, Unit="ft"
  H_radio_ft: double, Unit="ft"
  CG_percent_MAC: double, Unit="%"
  gear_animation_pos_0: double, Min=0, Max=1, Unit="1"
  gear_animation_pos_1: double, Min=0, Max=1, Unit="1"
  gear_animation_pos_2: double, Min=0, Max=1, Unit="1"
  flaps_handle_index: double, Min=0, Max=4, Unit="1"
  autopilot_master_on: double, Min=0, Max=1, Unit="1"
  slew_on: double, Min=0, Max=1, Unit="1"
  pause_on: double, Min=0, Max=1, Unit="1"

base_data = Simulink.Bus()
  nz_g: double, Unit="gn"
  Theta_deg: double, Unit="deg"
  Phi_deg: double, Unit="deg"
  q_deg_s: double, Unit="deg/s"
  r_deg_s: double, Unit="deg/s"
  p_deg_s: double
  qk_deg_s: double, Unit="deg/s"
  rk_deg_s: double, Unit="deg/s"
  pk_deg_s: double, Unit="deg/s"
  qk_dot_deg_s2: double, Unit="deg/s^2"
  rk_dot_deg_s2: double, Unit="deg/s^2"
  pk_dot_deg_s2: double, Unit="deg/s^2"
  eta_deg: double, Unit="deg"
  eta_trim_deg: double, Unit="deg"
  xi_deg: double, Unit="deg"
  zeta_deg: double, Unit="deg"
  zeta_trim_deg: double, Unit="deg"
  alpha_deg: double, Unit="deg"
  beta_deg: double, Unit="deg"
  beta_dot_deg_s: double, Unit="deg/s"
  V_ias_kn: double, Unit="kn"
  V_tas_kn: double, Unit="kn"
  V_mach: double, Unit="1"
  H_ft: double, Unit="ft"
  H_ind_ft: double, Unit="ft"
  H_radio_ft: double, Unit="ft"
  CG_percent_MAC: double, Unit="%"
  gear_strut_compression_0: double, Min=0, Max=1, Unit="1"
  gear_strut_compression_1: double, Min=0, Max=1, Unit="1"
  gear_strut_compression_2: double, Min=0, Max=1, Unit="1"
  flaps_handle_index: double, Min=0, Max=4, Unit="1"
  autopilot_master_on: double, Min=0, Max=1, Unit="1"
  slew_on: double, Min=0, Max=1, Unit="1"
  pause_on: double, Min=0, Max=1, Unit="1"

base_data_computed = Simulink.Bus()
  on_ground: double, Min=0, Max=1, Unit="1"
  tracking_mode_on: double